% Simulink data dictionary RL_data.sldd

reward_Rsuccess = 200
reward_Cdist = 4
reward_Rfail = 200
reward_Crate = 2
reward_Ck = 20
reward_Csteer_d = 40
reward_Cact_d = 1
reward_Calive = 0
reward_Cy = 1
reward_Cyaw = 10

BusActorPose = Simulink.Bus()
  ActorID: double
  Position: double[1 3]
  Velocity: double[1 3]
  Roll: double
  Pitch: double
  Yaw: double
  AngularVelocity: double[1 3]

initialAngle_deg = Simulink.Parameter(0, Unit="deg")